# Grasshopper definition 230516-print1.gh (Grasshopper 1.0.7)
# plug-ins: KUKA|prc - parametric robot control

rec_3pt = Rectangle3Pt(PointA=Point(-50, -25, 0), PointB=Point(650, -25, 0), PointC=Point(50, 875, 0))  # -> Rectangle, Length
rec_3pt_2 = Rectangle3Pt(PointA=Point(0, 0, 0), PointB=Point(550, 0, 0), PointC=Point(0, 850, 0))  # -> Rectangle, Length
series = Series(Start=0, Step=10, Count="50")
pt = ConstructPoint(XCoordinate="0", YCoordinate="0", ZCoordinate=0)
Z = UnitZ(Factor=series)
_1_5_mm = Geometry(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)
debrep = DeconstructBrep(Brep=_1_5_mm)  # -> Faces, Edges, Vertices
move = Move(Geometry=pt, Motion=Z)  # -> Geometry, Transform
range = Range(Domain=Domain(0, 1), Steps=expr("X-1", "50"))
item = ListItem(List=debrep.Faces, Index=Slider(1, range=0..12), Wrap=True)
graph = GraphMapper(
    range,
    x0=0,
    x1=1,
    y0=0,
    y1=180,
    container_name="Bezier",
    cpx=[0, 0.4019779861, 0.6163102388, 1],
    cpy=[1, 0.8010774255, 0.7099499702, 0.9805227518])
area = Area(Geometry=item)  # -> Area, Centroid
cir = Circle(Plane=move.Geometry, Radius=graph)
orient = Orient(Geometry=_1_5_mm, Source=area.Centroid, Target=pt)  # -> Geometry, Transform
dam = DataDam(BufferDelay=2500000, BufferMode=2)
construct_point = ConstructPoint(XCoordinate=0, YCoordinate=Slider(250, range=-300..600), ZCoordinate=0)
contour = Contour(Shape=orient.Geometry, Point=Point(0, 0, 0.75), Direction=Vector(0, 0, 1), Distance=Slider(2.5, range=0..10))
xz_plane = XZPlane(Origin=construct_point)
crv = Curve(contour)
curve_plane = CurvePlane(Curve=crv, Plane=xz_plane)  # -> Points, ParamsC, ParamsP
construct_point_2 = ConstructPoint(XCoordinate=-300, YCoordinate=0, ZCoordinate=0)
distance = Distance(PointA=curve_plane.Points, PointB=construct_point_2)
sort_list = SortList(Keys=distance, ValuesValuesA=curve_plane.ParamsC)  # -> Keys, ValuesValuesA
list_item = ListItem(List=sort_list.ValuesValuesA, Index=0, Wrap=True)
seam = Seam(Curve=graft(crv), Seam=list_item)
divide_curve = DivideCurve(Curve=seam, Count=Slider(200, range=0..1000), Kinks=False)  # -> Points, Tangents, Parameters
xy = XYPlane(Origin=flatten(divide_curve.Points))
X = UnitX(Factor=-100)
Y = UnitY(Factor=0)
addition = Addition(A=Y, B=X)
item_2 = ListItem(List=xy, Index=0, Wrap=True)
move_2 = Move(Geometry=item_2, Motion=addition)  # -> Geometry, Transform
ins = InsertItems(List=xy, Item=move_2.Geometry, Indices=0, Wrap=True)
item_3 = ListItem(List=reverse(ins), Index=0, Wrap=True)
Z_2 = UnitZ(Factor=150)
lng = ListLength(List=ins)
move_3 = Move(Geometry=item_3, Motion=Z_2)  # -> Geometry, Transform
ins_2 = InsertItems(List=ins, Item=move_3.Geometry, Indices=lng, Wrap=True)
xy_plane = XYPlane(Origin=Point(0, 0, 0))
xy_plane_2 = XYPlane(Origin=Point(0, 0, 9.5))
orient_2 = Orient(Geometry=ins_2, Source=PlaneXY(0, 0, 0), Target=xy_plane_2)  # -> Geometry, Transform
polyline = PolyLine(Vertices=orient_2.Geometry, Closed=False)
dam_2 = DataDam(DataA=orient_2.Geometry, BufferDelay=10000000, BufferMode=0)
length = Length(Curve=polyline)
linear_movement_kuka_prc = LINearMovementKUKAPrc(TargetAsPlane=dam_2, Speed=".02", extaxenabled=False, interpolation="C_DIS")
division = Division(A=length, B=1000)
panel = Panel(division)
mesh = Mesh([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])
kr30_60 = KR3060HARobot(infiniterot=False)
custom_tool = CustomToolKUKAPrc(
    CustomToolGeometry=mesh,
    toolid=3,
    toolvala=91.497,
    toolvalb=0.347,
    toolvalc=0,
    toolvalx=-4.717,
    toolvaly=369.382,
    toolvalz=113.566,
    valuesset=True)
kuka_prc = KUKAPrcCORE(
    SimulationSlider=Slider(1, range=0..1),
    KUKAPrcCommands=linear_movement_kuka_prc,
    Tool=custom_tool,
    Robot=kr30_60,
    PRC_BaseExpose=False,
    PRC_SaveNameExpose=False,
    PRCsettings="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")  # -> RobotGeometry, AnalysisOutput
