# Grasshopper definition SIN-VASE_JC_MASTER.gh (Grasshopper 1.0.7)
# plug-ins: Mesh Pipe, Kangaroo2 Components, KUKA|prc - parametric robot control

pt = ConstructPoint(XCoordinate=0, YCoordinate=0, ZCoordinate=0)
pi = Pi(Factor=Slider(2, range=0..10))
dom = ConstructDomain(DomainStart=0, DomainEnd=pi)
circle = CircleCNR(Center=pt, Normal=Vector(0, 0, 1), Radius=Slider(79, range=0..100))
series = Series(Start=0, Step=Slider(0.25, range=0..1), Count=Slider(26, range=0..100))
bnd = Bounds(Numbers=series)
sin = Sine(Value=series)
remap = RemapNumbers(Value=series, Source=bnd, Target=dom)  # -> Mapped, Clipped
pt_2 = ConstructPoint(XCoordinate=remap.Mapped, YCoordinate=sin, ZCoordinate=0)
dom_2 = ConstructDomain(DomainStart=0, DomainEnd=Slider(0.25, range=0..1))
number_slider = Slider(13, range=0..100)
pdecon = Deconstruct(Point=pt_2)  # -> XComponent, YComponent, ZComponent
intcrv = Interpolate(Vertices=pt_2, Degree=3, Periodic=False, KnotStyle=1)  # -> Curve, Length, Domain
bnd_2 = Bounds(Numbers=pdecon.XComponent)
neg = Negative(Value=number_slider)
remap_2 = RemapNumbers(Value=pdecon.XComponent, Source=bnd_2, Target=dom_2)  # -> Mapped, Clipped
bnd_3 = Bounds(Numbers=pdecon.YComponent)
dom_3 = ConstructDomain(DomainStart=neg, DomainEnd=number_slider)
remap_3 = RemapNumbers(Value=pdecon.YComponent, Source=bnd_3, Target=dom_3)  # -> Mapped, Clipped
eval = EvaluateCurve(Curve=reparameterize(circle), Parameter=remap_2.Mapped)  # -> Point, Tangent, Angle
Z = UnitZ(Factor=1)
xprod = CrossProduct(VectorA=eval.Tangent, VectorB=Z, Unitize=False)  # -> Vector, Length
amp = Amplitude(Vector=xprod.Vector, Amplitude=remap_3.Mapped)
move = Move(Geometry=eval.Point, Motion=amp)  # -> Geometry, Transform
intcrv_2 = Interpolate(Vertices=move.Geometry, Degree=3, Periodic=False, KnotStyle=1)  # -> Curve, Length, Domain
arrpolar = PolarArray(Geometry=intcrv_2.Curve, Plane=PlaneXY(0, 0, 0), Count=Slider(4, range=0..10), Angle=6.283185307)  # -> Geometry, Transform
join = JoinCurves(Curves=arrpolar.Geometry, Preserve=False)
divide = DivideCurve(Curve=join, Count=Slider(100, range=0..100), Kinks=False)  # -> flatten(Points), Tangents, Parameters
Z_2 = UnitZ(Factor=Slider(150, range=0..1000))
intcrv_3 = Interpolate(Vertices=divide.Points, Degree=3, Periodic=True, KnotStyle=1)  # -> Curve, Length, Domain
move_2 = Move(Geometry=intcrv_3.Curve, Motion=Z_2)  # -> Geometry, Transform
area = Area(Geometry=move_2.Geometry)  # -> Area, Centroid
scale = Scale(Geometry=move_2.Geometry, Center=area.Centroid, Factor=Slider(1.1, range=0..10))  # -> Geometry, Transform

# ----
# top sinusoid circle
# top sinusoid circle
number_slider_2 = Slider(0.246, range=0..1)
# mid sinusoid circle
number_slider_3 = Slider(79, range=0..100)
pi_2 = Pi(Factor=Slider(2, range=0..10))
pt_3 = ConstructPoint(XCoordinate=0, YCoordinate=0, ZCoordinate=0)
dom_4 = ConstructDomain(DomainStart=0, DomainEnd=pi_2)
series_2 = Series(Start=0, Step=number_slider_2, Count=Slider(52, range=0..100))
circle_2 = CircleCNR(Center=pt_3, Normal=Vector(0, 0, 1), Radius=number_slider_3)
bnd_4 = Bounds(Numbers=series_2)
sin_2 = Sine(Value=series_2)
remap_4 = RemapNumbers(Value=series_2, Source=bnd_4, Target=dom_4)  # -> Mapped, Clipped
pt_4 = ConstructPoint(XCoordinate=remap_4.Mapped, YCoordinate=sin_2, ZCoordinate=0)
dom_5 = ConstructDomain(DomainStart=0, DomainEnd=Slider(0.25, range=0..1))
sin_height = Slider(10, range=0..100)
pdecon_2 = Deconstruct(Point=pt_4)  # -> XComponent, YComponent, ZComponent
intcrv_4 = Interpolate(Vertices=pt_4, Degree=3, Periodic=False, KnotStyle=1)  # -> Curve, Length, Domain
bnd_5 = Bounds(Numbers=pdecon_2.XComponent)
neg_2 = Negative(Value=sin_height)
remap_5 = RemapNumbers(Value=pdecon_2.XComponent, Source=bnd_5, Target=dom_5)  # -> Mapped, Clipped
bnd_6 = Bounds(Numbers=pdecon_2.YComponent)
dom_6 = ConstructDomain(DomainStart=neg_2, DomainEnd=sin_height)
remap_6 = RemapNumbers(Value=pdecon_2.YComponent, Source=bnd_6, Target=dom_6)  # -> Mapped, Clipped
eval_2 = EvaluateCurve(Curve=reparameterize(circle_2), Parameter=remap_5.Mapped)  # -> Point, Tangent, Angle
Z_3 = UnitZ(Factor=1)
xprod_2 = CrossProduct(VectorA=eval_2.Tangent, VectorB=Z_3, Unitize=False)  # -> Vector, Length
amp_2 = Amplitude(Vector=xprod_2.Vector, Amplitude=remap_6.Mapped)
move_3 = Move(Geometry=eval_2.Point, Motion=amp_2)  # -> Geometry, Transform
intcrv_5 = Interpolate(Vertices=move_3.Geometry, Degree=3, Periodic=False, KnotStyle=1)  # -> Curve, Length, Domain
arrpolar_2 = PolarArray(Geometry=intcrv_5.Curve, Plane=PlaneXY(0, 0, 0), Count=Slider(4, range=0..10), Angle=6.283185307)  # -> Geometry, Transform
join_2 = JoinCurves(Curves=arrpolar_2.Geometry, Preserve=False)
divide_2 = DivideCurve(Curve=join_2, Count=Slider(100, range=0..100), Kinks=False)  # -> flatten(Points), Tangents, Parameters
Z_4 = UnitZ(Factor=Slider(294, range=0..1000))
intcrv_6 = Interpolate(Vertices=divide_2.Points, Degree=3, Periodic=True, KnotStyle=1)  # -> Curve, Length, Domain
move_4 = Move(Geometry=intcrv_6.Curve, Motion=Z_4)  # -> Geometry, Transform
area_2 = Area(Geometry=move_4.Geometry)  # -> Area, Centroid
scale_2 = Scale(Geometry=move_4.Geometry, Center=area_2.Centroid, Factor=Slider(1.6, range=0..10))  # -> Geometry, Transform

number_slider_4 = Slider(80, range=0..100)
pt_5 = ConstructPoint(XCoordinate=0, YCoordinate=0, ZCoordinate=0)
circle_3 = CircleCNR(Center=pt_5, Normal=Vector(0, 0, 1), Radius=number_slider_4)
pt_6 = ConstructPoint(XCoordinate="0", YCoordinate="0", ZCoordinate="9.5")
crv = Curve(circle_3)
merge = Merge(Data1=circle_3, Data2=scale.Geometry, Data3=scale_2.Geometry)
loft = Loft(Curves=merge, Options={Adjust=False, Closed=False, LoftEnds=0, LoftSimp=0, LoftType=0, Rebuild=10, Refit=0.01})
crv_2 = Curve([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])

# ----
# printed loft
brep = Brep(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)
crv_3 = Curve(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)

orient = Orient(Geometry=loft, Source=PlaneXY(0, 0, 0), Target=pt_6)  # -> Geometry, Transform

# ----
# vase wall toolpath
number_slider_5 = Slider(2.5, range=0..10)
contour = Contour(Shape=orient.Geometry, Point=Point(0, 0, 0.75), Direction=Vector(0, 0, 1), Distance=number_slider_5)
construct_point = ConstructPoint(XCoordinate=0, YCoordinate=0, ZCoordinate=0)
crv_4 = Curve(contour)
xz_plane = XZPlane(Origin=construct_point)
curve_plane = CurvePlane(Curve=crv_4, Plane=xz_plane)  # -> Points, ParamsC, ParamsP
construct_point_2 = ConstructPoint(XCoordinate=-300, YCoordinate=0, ZCoordinate=0)
distance = Distance(PointA=curve_plane.Points, PointB=construct_point_2)
sort_list = SortList(Keys=distance, ValuesValuesA=curve_plane.ParamsC)  # -> Keys, ValuesValuesA
list_item = ListItem(List=sort_list.ValuesValuesA, Index=0, Wrap=True)
seam = Seam(Curve=graft(crv_4), Seam=list_item)
eval_3 = EvaluateCurve(Curve=reparameterize(seam), Parameter=Slider(0.5, range=0..1))  # -> Point, Tangent, Angle
divide_curve = DivideCurve(Curve=seam, Count=Slider(200, range=0..1000), Kinks=False)  # -> Points, Tangents, Parameters
xy = XYPlane(Origin=flatten(divide_curve.Points))
X = UnitX(Factor=-100)
Y = UnitY(Factor=0)
addition = Addition(A=Y, B=X)
item = ListItem(List=xy, Index=0, Wrap=True)
move_5 = Move(Geometry=item, Motion=addition)  # -> Geometry, Transform
ins = InsertItems(List=xy, Item=move_5.Geometry, Indices=0, Wrap=True)
item_2 = ListItem(List=reverse(ins), Index=0, Wrap=True)
Z_5 = UnitZ(Factor=150)
lng = ListLength(List=ins)
move_6 = Move(Geometry=item_2, Motion=Z_5)  # -> Geometry, Transform
ins_2 = InsertItems(List=ins, Item=move_6.Geometry, Indices=lng, Wrap=True)
dam = DataDam(DataA=ins_2, BufferDelay=2500000, BufferMode=0)
linear_movement_kuka_prc = LINearMovementKUKAPrc(TargetAsPlane=dam, Speed=".02", extaxenabled=False, interpolation="C_DIS")
mesh = Mesh([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])
kr30_60 = KR3060HARobot(infiniterot=False)
custom_tool = CustomToolKUKAPrc(
    CustomToolGeometry=mesh,
    isExternal=False,
    toolid=3,
    toolvala=91.497,
    toolvalb=0.347,
    toolvalc=0,
    toolvalx=-4.717,
    toolvaly=369.382,
    toolvalz=113.566,
    valuesset=True)
kuka_prc = KUKAPrcCORE(
    SimulationSlider=Slider(1, range=0..1),
    KUKAPrcCommands=linear_movement_kuka_prc,
    Tool=custom_tool,
    Robot=kr30_60,
    PRC_BaseExpose=False,
    PRC_SaveNameExpose=False,
    PRCsettings="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")  # -> RobotGeometry, AnalysisOutput; disabled

# ----
# bottom cone
item_3 = ListItem(List=flatten(crv_4), Index=0, Wrap=True)
construct_point_3 = ConstructPoint(XCoordinate=0, YCoordinate=0, ZCoordinate=0)
area_3 = Area(Geometry=item_3)  # -> Area, Centroid
circle_4 = CircleCNR(Center=area_3.Centroid, Normal=Vector(0, 0, 1), Radius=number_slider_4)
xz_plane_2 = XZPlane(Origin=construct_point_3)
reb = RebuildCurve(Curve=circle_4, Count=10, Tangents=False)
crv_5 = Curve(reb)
curve_plane_2 = CurvePlane(Curve=crv_5, Plane=xz_plane_2)  # -> Points, ParamsC, ParamsP
construct_point_4 = ConstructPoint(XCoordinate=-300, YCoordinate=0, ZCoordinate=0)
distance_2 = Distance(PointA=curve_plane_2.Points, PointB=construct_point_4)
crv_6 = Curve(crv_5)
sort_list_2 = SortList(Keys=distance_2, ValuesValuesA=curve_plane_2.ParamsC)  # -> Keys, ValuesValuesA
list_item_2 = ListItem(List=sort_list_2.ValuesValuesA, Index=0, Wrap=True)
seam_2 = Seam(Curve=graft(crv_5), Seam=list_item_2)
number_slider_6 = Slider(5, range=0..10)
number_slider_7 = Slider(16, range=0..100)
item_4 = ListItem(List=flatten(seam_2), Index=0, Wrap=True)
series_3 = Series(Start=0, Step=number_slider_6, Count=number_slider_7)
neg_3 = Negative(Value=series_3)
offset = OffsetCurve(Curve=item_4, Distance=neg_3, Corners=1)
item_5 = ListItem(List=flatten(offset), Index=0, Wrap=True)  # -> Item1, Item
divide_3 = DivideCurve(Curve=seam_2, Count=Slider(200, range=0..1000), Kinks=False)  # -> Points, Tangents, Parameters
crv_7 = Curve(item_5.Item1)
pull = PullPoint(Point=divide_3.Points, Geometry=crv_7, ClosestOnly=True)  # -> ClosestPoint, Distance
python = GhPythonScript(
    xx=pull.ClosestPoint,
    x=divide_3.Points,
    y=Slider(15, range=0..100),
    d=Slider(2.55, range=0..10),
    offset=number_slider_6,
    h=Slider(2.5, range=0..10))  # -> out, xpoints; inputs xx: list of Point3d, x: list of Point3d, y: Int32
# ---------- python: Python ----------
__author__ = "judyt"
__version__ = "2023.05.15"

import rhinoscriptsyntax as rs

import ghpythonlib.components as gh
import math
import clr
from Grasshopper.Kernel.Data import GH_Path
from Grasshopper import DataTree

def nestedListToDataTree(nestedlist):
    dataTree = DataTree[object]()
    for i,item_list in enumerate (nestedlist):
        path = GH_Path(i)
        dataTree.AddRange(item_list,path)
    return dataTree


#height = math.sqrt(d**2 - offset**2)

height = h
print height
xpoints = []
points = x
pointsX = xx
for i in range (y):
    newpointsX = []
    newpoints = []
    center = gh.Average(points)
    for j in range(len(points)):
        #vecXYdir = gh.Vector2Pt(points[j], center, True)
        vecXYdir = rs.VectorUnitize(rs.VectorCreate(pointsX[j],points[j]))
        
        print vecXYdir
        vecXY = gh.Amplitude(vecXYdir, offset)
        
        vecZ = gh.UnitZ(height)
        vec = rs.VectorAdd(vecXY,vecZ)
        
        #vec =gh.ConstructPoint(vecXY[0],vecXY[1],vecXY[2]+height)
        
        newpoint = gh.Move(points[j],vec)['geometry']
        newpointX = gh.Move(pointsX[j],vecZ)['geometry']
        print newpointX
        newpoints.append(newpoint)
        newpointsX.append(newpointX)
    xpoints.append(newpoints)
    points = newpoints
    pointsX = newpointsX


xpoints = nestedListToDataTree(xpoints)
# ---------- end python ----------
pt_7 = Point(python.xpoints)
pline = PolyLine(Vertices=pt_7, Closed=True)
eval_4 = EvaluateCurve(Curve=reparameterize(pline), Parameter=Slider(0.98, range=0..1))  # -> Point, Tangent, Angle
shift = ShiftList(List=flatten(eval_4.Point), Shift=1, Wrap=False)
dist = Distance(PointA=flatten(eval_4.Point), PointB=shift)
mpipe = MeshPipe(
    Curve=pline,
    Radius=Slider(3.02, range=0..10),
    Accuracy=Slider(0.01, range=0..0.1),
    Rotation=0,
    Segments=Slider(15, range=0..100),
    Caps=2)
panel = Panel(dist)

construct_point_5 = ConstructPoint(XCoordinate=0, YCoordinate=0, ZCoordinate=0)
xz_plane_3 = XZPlane(Origin=construct_point_5)
construct_point_6 = ConstructPoint(XCoordinate=-300, YCoordinate=0, ZCoordinate=0)
# cone bottom path
crv_8 = Curve(flatten(pline))
curve_plane_3 = CurvePlane(Curve=crv_8, Plane=xz_plane_3)  # -> Points, ParamsC, ParamsP
distance_3 = Distance(PointA=curve_plane_3.Points, PointB=construct_point_6)
sort_list_3 = SortList(Keys=distance_3, ValuesValuesA=curve_plane_3.ParamsC)  # -> Keys, ValuesValuesA
list_item_3 = ListItem(List=sort_list_3.ValuesValuesA, Index=0, Wrap=True)
seam_3 = Seam(Curve=graft(crv_8), Seam=list_item_3)
eval_5 = EvaluateCurve(Curve=reparameterize(seam_3), Parameter=Slider(0.5, range=0..1))  # -> Point, Tangent, Angle
divide_curve_2 = DivideCurve(Curve=seam_3, Count=Slider(200, range=0..1000), Kinks=False)  # -> Points, Tangents, Parameters
xy_2 = XYPlane(Origin=flatten(divide_curve_2.Points))
X_2 = UnitX(Factor=-100)
Y_2 = UnitY(Factor=0)
addition_2 = Addition(A=Y_2, B=X_2)
item_6 = ListItem(List=xy_2, Index=0, Wrap=True)
move_7 = Move(Geometry=item_6, Motion=addition_2)  # -> Geometry, Transform
ins_3 = InsertItems(List=xy_2, Item=move_7.Geometry, Indices=0, Wrap=True)
item_7 = ListItem(List=reverse(ins_3), Index=0, Wrap=True)
Z_6 = UnitZ(Factor=150)
lng_2 = ListLength(List=ins_3)
move_8 = Move(Geometry=item_7, Motion=Z_6)  # -> Geometry, Transform
ins_4 = InsertItems(List=ins_3, Item=move_8.Geometry, Indices=lng_2, Wrap=True)
dam_2 = DataDam(DataA=ins_4, BufferDelay=10000000, BufferMode=0)

number_slider_8 = Slider(1.18, range=0..10)  # disabled
series_4 = Series(Start=0, Step=number_slider_8, Count=number_slider_7)  # disabled
number_slider_9 = Slider(0.34, range=0..1)  # disabled
Z_7 = UnitZ(Factor=series_4)  # disabled
move_9 = Move(Geometry=flatten(offset), Motion=Z_7)  # -> Geometry, Transform; disabled
eval_6 = EvaluateCurve(Curve=reparameterize(move_9.Geometry), Parameter=number_slider_9)  # -> Point, Tangent, Angle; disabled
number_slider_10 = Slider(0.01, range=0..0.1)  # disabled
number_slider_11 = Slider(1.25, range=0..10)  # disabled
number_slider_12 = Slider(15, range=0..100)  # disabled
shift_2 = ShiftList(List=flatten(eval_6.Point), Shift=1, Wrap=False)  # disabled
dist_2 = Distance(PointA=flatten(eval_6.Point), PointB=shift_2)  # disabled
mpipe_2 = MeshPipe(Curve=move_9.Geometry, Radius=number_slider_11, Accuracy=number_slider_10, Rotation=0, Segments=number_slider_12, Caps=2)  # disabled
panel_2 = Panel(dist_2)  # disabled

# ----
# combined toolpath
merge_2 = Merge(Data1=ins_3, Data2=ins)
duppt = RemoveDuplicatePts(Points=merge_2, Tolerance=Slider(1, range=0..1))
pline_2 = PolyLine(Vertices=duppt, Closed=False)
xy_3 = XYPlane(Origin=duppt)
item_8 = ListItem(List=reverse(duppt), Index=0, Wrap=True)
lng_3 = ListLength(List=duppt)
len = Length(Curve=pline_2)
Z_8 = UnitZ(Factor=150)
panel_3 = Panel("""40%
50m- 1h""")
panel_4 = Panel(len)
move_10 = Move(Geometry=item_8, Motion=Z_8)  # -> Geometry, Transform
ins_5 = InsertItems(List=duppt, Item=move_10.Geometry, Indices=lng_3, Wrap=True)
dam_3 = DataDam(DataA=ins_5, BufferDelay=2500000, BufferMode=0)
linear_movement_kuka_prc_2 = LINearMovementKUKAPrc(TargetAsPlane=dam_3, Speed=".02", extaxenabled=False, interpolation="C_DIS")
mesh_2 = Mesh([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])
kr30_60_2 = KR3060HARobot(infiniterot=False)
custom_tool_2 = CustomToolKUKAPrc(
    CustomToolGeometry=mesh_2,
    isExternal=False,
    toolid=3,
    toolvala=91.497,
    toolvalb=0.347,
    toolvalc=0,
    toolvalx=-4.717,
    toolvaly=369.382,
    toolvalz=113.566,
    valuesset=True)
kuka_prc_2 = KUKAPrcCORE(
    SimulationSlider=Slider(1, range=0..1),
    KUKAPrcCommands=linear_movement_kuka_prc_2,
    Tool=custom_tool_2,
    Robot=kr30_60_2,
    PRC_BaseExpose=False,
    PRC_SaveNameExpose=False,
    PRCsettings="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")  # -> RobotGeometry, AnalysisOutput

duppt_2 = RemoveDuplicatePts(Points=merge_2, Tolerance=Slider(2, range=0..2.5))
xy_4 = XYPlane(Origin=duppt_2)
