# Grasshopper definition codigos bancos y espiral-JC-bottom-master.gh (Grasshopper 1.0.7)
# plug-ins: KUKA|prc - parametric robot control, Parakeet, Pufferfish, Kangaroo2 Components, Mesh Pipe

brep = Brep(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)
pt = ConstructPoint(XCoordinate="300", YCoordinate="250", ZCoordinate=0)
scale = Scale(Geometry=brep, Center=Point(0, 0, 0), Factor=Slider(200, range=0..1000))  # -> Geometry, Transform
cap = CapHoles(Brep=scale.Geometry)
bbox = BoundingBox(Content=scale.Geometry, Plane=PlaneXY(0, 0, 0))  # -> Box, Box_2
debrep = DeconstructBrep(Brep=bbox.Box)  # -> Faces, Edges, Vertices
item = ListItem(List=debrep.Faces, Index=Slider(4, range=0..12), Wrap=True)
area = Area(Geometry=item)  # -> Area, Centroid
orient = Orient(Geometry=scale.Geometry, Source=area.Centroid, Target=pt)  # -> Geometry, Transform

debrep_2 = DeconstructBrep(Brep=orient.Geometry)  # -> Faces, Edges, Vertices
item_2 = ListItem(List=debrep_2.Faces, Index=Slider(4, range=0..6), Wrap=True)
item_3 = ListItem(List=debrep_2.Faces, Index=Slider(0, range=0..6), Wrap=True)
flippsrf = FlipPolysurface(Polysurface=item_2)  # -> Flipped, R
debrep_3 = DeconstructBrep(Brep=item_3)  # -> Faces, Edges, Vertices
debrep_4 = DeconstructBrep(Brep=item_2)  # -> Faces, Edges, Vertices
item_4 = ListItem(List=debrep_3.Edges, Index=Slider(2, range=0..6), Wrap=True)
item_5 = ListItem(List=debrep_4.Edges, Index=Slider(0, range=0..6), Wrap=True)
item_6 = ListItem(List=debrep_3.Edges, Index=Slider(0, range=0..6), Wrap=True)
item_7 = ListItem(List=debrep_4.Edges, Index=Slider(3, range=0..6), Wrap=True)
flip = FlipCurve(Curve=item_5)  # -> Curve, Flag
flip_2 = FlipCurve(Curve=item_7)  # -> Curve, Flag
loft = Loft(
    Curves=[flip.Curve, item_4],
    Options={Adjust=False, Closed=False, LoftEnds=0, LoftSimp=0, LoftType=0, Rebuild=10, Refit=0.01})
loft_2 = Loft(
    Curves=[flip_2.Curve, item_6],
    Options={Adjust=False, Closed=False, LoftEnds=0, LoftSimp=0, LoftType=0, Rebuild=10, Refit=0.01})

# ---- group: Choose one load (applied to all points) or a list of loads (one per point)
genes = GenePool(Decimals=2, Maximum=1, Minimum=0, Value=[0.5, 1, 0.5, 0.5, 0.5, 0.5, 0.5, 0.5, 0.5, 0.5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])
Z = UnitZ(Factor="6")
Z_2 = UnitZ(Factor=genes)
loads = Data(Z)

# ---- group: Choose one q (applied to all points) or a list of qs
q = Slider(0.633, range=0.001..1)
genes_2 = GenePool(Decimals=2, Maximum=1, Minimum=0, Value=[0.5, 1, 0.5, 0.5, 0.5, 0.5, 0.5, 0.5, 0.5, 0.5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])
force_densities = Data(q)

# ----
edges = BrepEdges(Brep=orient.Geometry)  # -> Naked, Interior, NonManifold
item_8 = ListItem(List=debrep_2.Faces, Index=Slider(3, range=0..6), Wrap=True)
edges_2 = BrepEdges(Brep=item_8)  # -> Naked, Interior, NonManifold
item_9 = ListItem(List=edges_2.Naked, Index=0, Wrap=True)  # -> Item, Item1, Item2, Item3
loft_3 = Loft(
    Curves=[item_9.Item, item_9.Item3],
    Options={Adjust=False, Closed=False, LoftEnds=0, LoftSimp=0, LoftType=0, Rebuild=10, Refit=0.01})
mesh_uv = MeshSurface(Surface=loft_3, UCount=Slider(7, range=0..100), VCount=Slider(28, range=0..100), Overhang=True, Equalize=True)
medges = MeshEdges(Mesh=mesh_uv)  # -> NakedEdges, InteriorEdges, NonManifoldEdges
line = Line(medges.NakedEdges)
join = JoinCurves(Curves=line, Preserve=False)
line_2 = Line([medges.InteriorEdges, medges.NakedEdges])
crv = Curve(line_2)
crv_2 = Curve(join)
ccx = CurveCurve(CurveA=crv, CurveB=crv)  # -> Points, ParamsA, ParamsB
cset = CreateSet(List=flatten(ccx.Points))  # -> Set, Map
python_script = PythonScript(nodes=cset.Set, edges=crv, support_curve=crv_2, force_densities=force_densities, loads=loads)  # -> lines; inputs nodes: list, edges: list, force_densities: list, loads: list
# ---------- python_script: Python ----------
import os
from clr import AddReferenceToFileAndPath as addref
location = os.path.join(os.path.dirname(
    ghenv.Component.OnPingDocument().FilePath), 'MathNet.Numerics.dll') 
addref(location)

import MathNet.Numerics.LinearAlgebra as la
from System import Array as sys_array

import Rhino.Geometry as rg
import Rhino.Collections.Point3dList as Point3dList
import rhinoscriptsyntax as rs

# import rhino objects
rhnodes = rs.coerce3dpointlist(nodes, True)
rhedges = [rs.coerceline(edge) for edge in edges]
rhsupport = rs.coercecurve(support_curve)

# Matrix constructor
M = la.Double.Matrix.Build

nn = len(nodes)
ne = len(edges)
C  = M.Dense(ne, nn)

# Create Connectivity matrix
for (i, edge) in enumerate(rhedges):
    istart = Point3dList.ClosestIndexInList(rhnodes, edge.From)
    iend   = Point3dList.ClosestIndexInList(rhnodes, edge.To)
    C[i, istart] = -1
    C[i, iend]   = 1
    

# Construct coordinate vector
x = [node.X for node in rhnodes]
y = [node.Y for node in rhnodes]
z = [node.Z for node in rhnodes]

coordn = M.Dense(nn, 3)
for i in range(nn):
    coordn[i,0] = x[i]
    coordn[i,1] = y[i]
    coordn[i,2] = z[i]

# Construct force vector
px = [0 for i in range(nn)]
py = [0 for i in range(nn)]
pz = [0 for i in range(nn)]

p = M.Dense(nn, 3)
if len(loads) == 1:
    for i in range(nn):
        p[i,0] = loads[0][0]
        p[i,1] = loads[0][1]
        p[i,2] = loads[0][2]
else:
    if len(loads) != nn:
        raise ValueError("Error: loads vector length =/= num of nodes")
    else:
        for i in range(nn):
            p[i,0] = loads[i][0]
            p[i,1] = loads[i][1]
            p[i,2] = loads[i][2]

# Force Densities
q = force_densities
if len(q) == 1:
    Q = M.DenseIdentity(ne) * q[0]
else:
    if len(q) != ne:
        raise ValueError("Error: force densities vector length =/= num of edges")
    else:
        Q = M.DenseIdentity(ne)
        for i, qq in enumerate(q):
            Q[i,i] = qq

# Fix nodes
fixed = []
for (i, node) in enumerate(rhnodes):
    param  = rhsupport.ClosestPoint(node, 1)[1]
    closep = rhsupport.PointAt(param)
    on_support = (closep - node).IsTiny()
    if on_support:
        fixed.append(i)
free = [i for i in range(nn) if i not in fixed]

# Reorder C and coords
C_f = la.Double.Matrix.Build.DenseOfColumns(
    C.Column(i) for i in fixed
)

C_i = la.Double.Matrix.Build.DenseOfColumns(
    C.Column(i) for i in free
)

# find fix-fix linking members
null_members = [i for i in range(C_i.RowCount) if C_i.Row(i).L2Norm() == 0]

# shift indices to build the remove index list
null_members = [x - y for x, y in zip(
        null_members, range(len(null_members)))]

# delete fix-fix link member related row
for i in null_members:
    C_i = C_i.RemoveRow(i)
    C_f = C_f.RemoveRow(i)
    Q = Q.RemoveRow(i)
    Q = Q.RemoveColumn(i)

# node fix & free
n_f = la.Double.Matrix.Build.DenseOfRows(
    coordn.Row(i) for i in fixed
)

n_i = la.Double.Matrix.Build.DenseOfRows(
    coordn.Row(i) for i in free
)

p_i = la.Double.Matrix.Build.DenseOfRows(
    p.Row(i) for i in free
)

# Solve
D_i = C_i.Transpose() * Q * C_i
D_f = C_i.Transpose() * Q * C_f
coordn_i = D_i.LU().Solve(p_i - D_f * n_f)

# substitute new free node in coordn
for (i, o_id) in enumerate(free):
    coordn[o_id, 0] = coordn_i[i, 0]
    coordn[o_id, 1] = coordn_i[i, 1]
    coordn[o_id, 2] = coordn_i[i, 2]

# Draw
lines = []
for i in range(C.RowCount):
    # C is free of fix-fix linking member now!
    # index of free nodes in edge-node matrix C
    # edge by edge (row by row)
    i_id = [j for j in range(C.ColumnCount) if C[i,j] != 0]
    l = rg.Line(rg.Point3d(coordn[i_id[0], 0],
                           coordn[i_id[0], 1],
                           coordn[i_id[0], 2]),
                rg.Point3d(coordn[i_id[1], 0],
                           coordn[i_id[1], 1],
                           coordn[i_id[1], 2]))
    lines.append(l)
# ---------- end python_script ----------
end = EndPoints(Curve=python_script)  # -> Start, End
item_10 = ListItem(List=python_script, Index=Slider(1, range=0..100), Wrap=True)
duppt = RemoveDuplicatePts(Points=[end.Start, end.End], Tolerance=0.01)
del = DelaunayMesh(Points=duppt, Plane=PlaneXY(0, 0, 0))
fillet = Fillet(Curve=crv_2, Radius=Slider(10, range=0..10))
contour = Contour(Shape=del, Point=Point(0, 0, 0.75), Direction=Vector(0, 0, 1), Distance=Slider(2.5, range=0..10))  # -> flatten(Contours)
medges_2 = MeshEdges(Mesh=del)  # -> NakedEdges, InteriorEdges, NonManifoldEdges
reb = RebuildCurve(Curve=contour, Degree=Slider(3, range=0..10), Count=Slider(46, range=0..100), Tangents=False)  # -> graft(Curve)
construct_point = ConstructPoint(XCoordinate=0, YCoordinate=Slider(250, range=0..1000), ZCoordinate=0)
xz_plane = XZPlane(Origin=construct_point)
crv_3 = Curve(reb)
curve_plane = CurvePlane(Curve=reb, Plane=xz_plane)  # -> Points, ParamsC, ParamsP
construct_point_2 = ConstructPoint(XCoordinate=-300, YCoordinate=0, ZCoordinate=0)
distance = Distance(PointA=curve_plane.Points, PointB=construct_point_2)
sort_list = SortList(Keys=distance, ValuesValuesA=curve_plane.ParamsC)  # -> Keys, ValuesValuesA
list_item = ListItem(List=sort_list.ValuesValuesA, Index=0, Wrap=True)
seam = Seam(Curve=graft(crv_3), Seam=list_item)
eval = EvaluateCurve(Curve=seam, Parameter=Slider(0.5, range=0..1))  # -> Point, Tangent, Angle
divide = DivideCurve(Curve=seam, Count=Slider(50, range=0..100), Kinks=False)  # -> Points, Tangents, Parameters
flip_3 = FlipMatrix(Data=divide.Points)
shift = ShiftList(List=flip_3, Shift=1, Wrap=False)
item_11 = ListItem(List=flip_3, Index=0, Wrap=True)
dist = Distance(PointA=flip_3, PointB=shift)  # -> flatten(Distance)
sort = SortList(Keys=dist)  # -> Keys, ValuesA
roundd = RoundToDecimalPlace(NumberX=sort.Keys, DecimalPlace=Slider(2, range=0..10), RoundType=0)  # -> Rounded, Difference
panel = Panel(roundd.Rounded)
bnd = Bounds(Numbers=panel)
panel_2 = Panel(bnd)

brepoffset = OffsetBrep(Brep=orient.Geometry, Distance=<missing>, Solid=True, BothSides=False, RoundCorners=True, MergeFaces=False)
join_2 = BrepJoin(Breps=flatten([item_3, item_2, loft, loft_2]))  # -> Breps, Closed
construct_point_3 = ConstructPoint(XCoordinate=0, YCoordinate=Slider(250, range=-300..600), ZCoordinate=0)
xz_plane_2 = XZPlane(Origin=construct_point_3)
contour_2 = Contour(Shape=join_2.Breps, Point=Point(0, 0, 0.75), Direction=Vector(0, 0, 1), Distance=Slider(2.5, range=0..10))
construct_point_4 = ConstructPoint(XCoordinate=0, YCoordinate=Slider(250, range=-300..600), ZCoordinate=0)
construct_point_5 = ConstructPoint(XCoordinate=-300, YCoordinate=0, ZCoordinate=0)
crv_4 = Curve(contour_2)
xz_plane_3 = XZPlane(Origin=construct_point_4)
cls = Closed(Curve=crv_4)  # -> Closed, Periodic
curve_plane_2 = CurvePlane(Curve=crv_4, Plane=xz_plane_3)  # -> Points, ParamsC, ParamsP
panel_3 = Panel(cls.Periodic)
construct_point_6 = ConstructPoint(XCoordinate=-300, YCoordinate=0, ZCoordinate=0)
eval_2 = EvaluateCurve(Curve=reparameterize(crv_4), Parameter=Slider(0.5, range=0..1))  # -> Point, Tangent, Angle
fillet_2 = Fillet(Curve=crv_4, Radius=Slider(11, range=0..100))
mpipe = MeshPipe(
    Curve=fillet_2,
    Radius=Slider(1.25, range=0..10),
    Accuracy=Slider(0.01, range=0..0.1),
    Rotation=0,
    Segments=Slider(15, range=0..100),
    Caps=2)
distance_2 = Distance(PointA=curve_plane_2.Points, PointB=construct_point_6)
sort_list_2 = SortList(Keys=distance_2, ValuesValuesA=curve_plane_2.ParamsC)  # -> Keys, ValuesValuesA
list_item_2 = ListItem(List=sort_list_2.ValuesValuesA, Index=0, Wrap=True)
seam_2 = Seam(Curve=graft(fillet_2), Seam=list_item_2)
eval_3 = EvaluateCurve(Curve=reparameterize(seam_2), Parameter=Slider(0.5, range=0..1))  # -> Point, Tangent, Angle
X = UnitX(Factor=-100)
Y = UnitY(Factor=0)
divide_curve = DivideCurve(Curve=seam_2, Count=Slider(200, range=0..1000), Kinks=False)  # -> Points, Tangents, Parameters
addition = Addition(A=Y, B=X)
xy = XYPlane(Origin=flatten(divide_curve.Points))
X_2 = UnitX(Factor=-100)
Y_2 = UnitY(Factor=0)
addition_2 = Addition(A=Y_2, B=X_2)
item_12 = ListItem(List=xy, Index=0, Wrap=True)
move = Move(Geometry=item_12, Motion=addition_2)  # -> Geometry, Transform
item_13 = ListItem(List=shift, Index=0, Wrap=True)
Z_3 = UnitZ(Factor=150)
ins = InsertItems(List=xy, Item=move.Geometry, Indices=0, Wrap=True)
pt_2 = Point(ins)
item_14 = ListItem(List=reverse(ins), Index=0, Wrap=True)
Z_4 = UnitZ(Factor=150)
lng = ListLength(List=ins)
move_2 = Move(Geometry=item_14, Motion=Z_4)  # -> Geometry, Transform
custom_tool_for_kuka_prc = CustomToolForKUKAPrc(
    isExternal=False,
    toolid=5,
    toolvala=1.766,
    toolvalb=-0.504,
    toolvalc=0,
    toolvalx=429.167,
    toolvaly=7.075,
    toolvalz=139.117,
    valuesset=True)
ins_2 = InsertItems(List=ins, Item=move_2.Geometry, Indices=lng, Wrap=True)
kr30_60 = KR3060HARobot(infiniterot=False)
dam = DataDam(DataA=ins_2, BufferDelay=2500000, BufferMode=0)
custom_tool_for_kuka_prc_2 = CustomToolForKUKAPrc(
    isExternal=False,
    toolid=5,
    toolvala=1.766,
    toolvalb=-0.504,
    toolvalc=0,
    toolvalx=429.167,
    toolvaly=7.075,
    toolvalz=139.117,
    valuesset=True)
lin_move = LINearMovementKUKAPrc(TargetAsPlane=dam, Speed="0.02", extaxenabled=False, interpolation="C_DIS")
kr30_60_2 = KR3060HARobot(infiniterot=False)
kuka_prc_core = KUKAPrcCORE(
    SimulationSlider=Slider(1, range=0..1),
    KUKAPrcCommands=lin_move,
    Tool=custom_tool_for_kuka_prc_2,
    Robot=kr30_60_2,
    PRC_BaseExpose=False,
    PRC_SaveNameExpose=False,
    PRCsettings="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")  # -> RobotGeometry, AnalysisOutput; disabled

construct_point_7 = ConstructPoint(XCoordinate=0, YCoordinate=Slider(250, range=-300..600), ZCoordinate=0)
xz_plane_4 = XZPlane(Origin=construct_point_7)
curve_plane_3 = CurvePlane(Curve=crv_3, Plane=xz_plane_4)  # -> Points, ParamsC, ParamsP
construct_point_8 = ConstructPoint(XCoordinate=-300, YCoordinate=0, ZCoordinate=0)
distance_3 = Distance(PointA=curve_plane_3.Points, PointB=construct_point_8)
sort_list_3 = SortList(Keys=distance_3, ValuesValuesA=curve_plane_3.ParamsC)  # -> Keys, ValuesValuesA
list_item_3 = ListItem(List=sort_list_3.ValuesValuesA, Index=0, Wrap=True)
seam_3 = Seam(Curve=graft(crv_3), Seam=list_item_3)
number_slider = Slider(22, range=0..100)
number_slider_2 = Slider(2.2, range=0..10)
project = Project(Geometry=seam_3, Plane=PlaneXY(0, 0, 0))  # -> Geometry, Transform
item_15 = ListItem(List=flatten(project.Geometry), Index=0, Wrap=True)
series = Series(Start=0, Step=number_slider_2, Count=number_slider)
offset = OffsetCurve(Curve=item_15, Distance=series, Corners=1)
item_16 = ListItem(List=flatten(offset), Index=0, Wrap=True)  # -> Item1, Item
divide_2 = DivideCurve(Curve=item_16.Item, Count=Slider(200, range=0..1000), Kinks=False)  # -> Points, Tangents, Parameters
pull = PullPoint(Point=divide_2.Points, Geometry=item_16.Item1, ClosestOnly=True)  # -> ClosestPoint, Distance
series_2 = Series(Start=0, Step=Slider(1.18, range=0..10), Count=number_slider)
Z_5 = UnitZ(Factor=series_2)
number_slider_3 = Slider(18, range=0..100)
move_3 = Move(Geometry=flatten(offset), Motion=Z_5)  # -> Geometry, Transform
eval_4 = EvaluateCurve(Curve=reparameterize(move_3.Geometry), Parameter=Slider(0.34, range=0..1))  # -> Point, Tangent, Angle
shift_2 = ShiftList(List=flatten(eval_4.Point), Shift=1, Wrap=False)
dist_2 = Distance(PointA=flatten(eval_4.Point), PointB=shift_2)
mpipe_2 = MeshPipe(
    Curve=move_3.Geometry,
    Radius=Slider(1.25, range=0..10),
    Accuracy=Slider(0.01, range=0..0.1),
    Rotation=0,
    Segments=Slider(15, range=0..100),
    Caps=2)
panel_4 = Panel(dist_2)
divide_3 = DivideCurve(Curve=move_3.Geometry, Count=Slider(50, range=0..100), Kinks=False)  # -> Points, Tangents, Parameters
flip_4 = FlipMatrix(Data=divide_3.Points)
shift_3 = ShiftList(List=flip_4, Shift=1, Wrap=False)
item_17 = ListItem(List=flip_4, Index=0, Wrap=True)
item_18 = ListItem(List=shift_3, Index=0, Wrap=True)
dist_3 = Distance(PointA=item_17, PointB=item_18)  # -> flatten(Distance)
sort_2 = SortList(Keys=dist_3)  # -> Keys, ValuesA
roundd_2 = RoundToDecimalPlace(NumberX=sort_2.Keys, DecimalPlace=Slider(2, range=0..10), RoundType=0)  # -> Rounded, Difference
panel_5 = Panel(roundd_2.Rounded)
bnd_2 = Bounds(Numbers=panel_5)
panel_6 = Panel(bnd_2)

divide_4 = DivideCurve(Curve=item_16.Item1, Count=Slider(200, range=0..1000), Kinks=False)  # -> Points, Tangents, Parameters

python = GhPythonScript(xx=divide_4.Points, x=divide_2.Points, y=Slider(21, range=0..100), d=Slider(2.5, range=0..10), offset=number_slider_2)  # -> out, xpoints; inputs xx: list of Point3d, x: list of Point3d, y: Int32
# ---------- python: Python ----------
__author__ = "judyt"
__version__ = "2023.05.15"

import rhinoscriptsyntax as rs

import ghpythonlib.components as gh
import math
import clr
from Grasshopper.Kernel.Data import GH_Path
from Grasshopper import DataTree

def nestedListToDataTree(nestedlist):
    dataTree = DataTree[object]()
    for i,item_list in enumerate (nestedlist):
        path = GH_Path(i)
        dataTree.AddRange(item_list,path)
    return dataTree


height = math.sqrt(d**2 - offset**2)
print height
xpoints = []
points = x
pointsX = xx
for i in range (y):
    newpointsX = []
    newpoints = []
    center = gh.Average(points)
    for j in range(len(points)):
        #vecXYdir = gh.Vector2Pt(points[j], center, True)
        vecXYdir = rs.VectorUnitize(rs.VectorCreate(pointsX[j],points[j]))
        
        print vecXYdir
        vecXY = gh.Amplitude(vecXYdir, offset)
        
        vecZ = gh.UnitZ(height)
        vec = rs.VectorAdd(vecXY,vecZ)
        
        #vec =gh.ConstructPoint(vecXY[0],vecXY[1],vecXY[2]+height)
        
        newpoint = gh.Move(points[j],vec)['geometry']
        newpointX = gh.Move(pointsX[j],vecZ)['geometry']
        print newpointX
        newpoints.append(newpoint)
        newpointsX.append(newpointX)
    xpoints.append(newpoints)
    points = newpoints
    pointsX = newpointsX


xpoints = nestedListToDataTree(xpoints)
# ---------- end python ----------
pt_3 = Point(python.xpoints)
pline = PolyLine(Vertices=pt_3, Closed=True)
eval_5 = EvaluateCurve(Curve=reparameterize(pline), Parameter=Slider(0.68, range=0..1))  # -> Point, Tangent, Angle
shift_4 = ShiftList(List=flatten(eval_5.Point), Shift=1, Wrap=False)
mpipe_3 = MeshPipe(
    Curve=pline,
    Radius=Slider(1.25, range=0..10),
    Accuracy=Slider(0.01, range=0..0.1),
    Rotation=0,
    Segments=Slider(15, range=0..100),
    Caps=2)
dist_4 = Distance(PointA=flatten(eval_5.Point), PointB=shift_4)
panel_7 = Panel(dist_4)
divide_5 = DivideCurve(Curve=pline, Count=Slider(50, range=0..100), Kinks=False)  # -> Points, Tangents, Parameters
flip_5 = FlipMatrix(Data=divide_5.Points)
shift_5 = ShiftList(List=flip_5, Shift=1, Wrap=False)
item_19 = ListItem(List=flip_5, Index=0, Wrap=True)
item_20 = ListItem(List=shift_5, Index=0, Wrap=True)
dist_5 = Distance(PointA=item_19, PointB=item_20)  # -> flatten(Distance)
sort_3 = SortList(Keys=dist_5)  # -> Keys, ValuesA
roundd_3 = RoundToDecimalPlace(NumberX=sort_3.Keys, DecimalPlace=Slider(2, range=0..10), RoundType=0)  # -> Rounded, Difference
panel_8 = Panel(roundd_3.Rounded)
bnd_3 = Bounds(Numbers=panel_8)
panel_9 = Panel(bnd_3)

crv_5 = Curve(pline)
curve_plane_4 = CurvePlane(Curve=crv_5, Plane=xz_plane_2)  # -> Points, ParamsC, ParamsP
distance_4 = Distance(PointA=curve_plane_4.Points, PointB=construct_point_5)
sort_list_4 = SortList(Keys=distance_4, ValuesValuesA=curve_plane_4.ParamsC)  # -> Keys, ValuesValuesA
list_item_4 = ListItem(List=sort_list_4.ValuesValuesA, Index=0, Wrap=True)
seam_4 = Seam(Curve=graft(crv_5), Seam=list_item_4)
eval_6 = EvaluateCurve(Curve=reparameterize(seam_4), Parameter=Slider(0.5, range=0..1))  # -> Point, Tangent, Angle
divide_curve_2 = DivideCurve(Curve=seam_4, Count=Slider(200, range=0..1000), Kinks=False)  # -> Points, Tangents, Parameters
xy_2 = XYPlane(Origin=flatten(divide_curve_2.Points))
item_21 = ListItem(List=xy_2, Index=0, Wrap=True)
move_4 = Move(Geometry=item_21, Motion=addition)  # -> Geometry, Transform
ins_3 = InsertItems(List=xy_2, Item=move_4.Geometry, Indices=0, Wrap=True)
pt_4 = Point(ins_3)
item_22 = ListItem(List=reverse(ins_3), Index=0, Wrap=True)
lng_2 = ListLength(List=ins_3)
move_5 = Move(Geometry=item_22, Motion=Z_3)  # -> Geometry, Transform

fsim = FindSimilarMember(Data=pt_4, Set=pt_2)  # -> Hit, Index
merge = Merge(Data1=ins_3, Data2=ins)
ins_4 = InsertItems(List=ins_3, Item=move_5.Geometry, Indices=lng_2, Wrap=True)
# tool path together
duppt_2 = RemoveDuplicatePts(Points=merge, Tolerance=Slider(1, range=0..1))
item_23 = ListItem(List=reverse(duppt_2), Index=0, Wrap=True)
Z_6 = UnitZ(Factor=150)
lng_3 = ListLength(List=duppt_2)
move_6 = Move(Geometry=item_23, Motion=Z_6)  # -> Geometry, Transform
ins_5 = InsertItems(List=duppt_2, Item=move_6.Geometry, Indices=lng_3, Wrap=True)
dam_2 = DataDam(DataA=ins_5, BufferDelay=2500000, BufferMode=0)
custom_tool_for_kuka_prc_3 = CustomToolForKUKAPrc(
    isExternal=False,
    toolid=5,
    toolvala=1.766,
    toolvalb=-0.504,
    toolvalc=0,
    toolvalx=429.167,
    toolvaly=7.075,
    toolvalz=139.117,
    valuesset=True)
lin_move_2 = LINearMovementKUKAPrc(TargetAsPlane=dam_2, Speed="0.02", extaxenabled=False, interpolation="C_DIS")
kr30_60_3 = KR3060HARobot(infiniterot=False)
kuka_prc_core_2 = KUKAPrcCORE(
    SimulationSlider=Slider(0, range=0..1),
    KUKAPrcCommands=lin_move_2,
    Tool=custom_tool_for_kuka_prc_3,
    Robot=kr30_60_3,
    PRC_BaseExpose=False,
    PRC_SaveNameExpose=False,
    PRCsettings="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")  # -> RobotGeometry, AnalysisOutput

dam_3 = DataDam(DataA=ins_4, BufferDelay=10000000, BufferMode=0)
lin_move_3 = LINearMovementKUKAPrc(TargetAsPlane=dam_3, Speed="0.02", extaxenabled=False, interpolation="C_DIS")
kuka_prc_core_3 = KUKAPrcCORE(
    SimulationSlider=Slider(0, range=0..1),
    KUKAPrcCommands=lin_move_3,
    Tool=custom_tool_for_kuka_prc,
    Robot=kr30_60,
    PRC_BaseExpose=False,
    PRC_SaveNameExpose=False,
    PRCsettings="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")  # -> RobotGeometry, AnalysisOutput; disabled
